# Dynamo graph FeatureLine_Length.dyn (Dynamo 2.12.0.5650)
# packages: Civil3DToolkit 1.1.32

# group: PSET
string = StringInput("PSET_01_Anagrafico_geografico")
string_2 = StringInput("PSET_03_Esercizio")
string_3 = StringInput("PSET_06_Computazione_Tratti_di_rete")
string_4 = StringInput("PSET_04_Amministrativo")
string_5 = StringInput("PSET_05_Realizzazione")
string_6 = StringInput("PSET_07_Computazione_GR")
string_7 = StringInput("PSET_02_Fisico_geometrico")
string_8 = StringInput("APPOGGIO")

# group: INPUT
seleziona_featureline = ObjectSelection()  # 1 picked in the model; graph input

# group: LENGTH
string_9 = StringInput("NR_LUNGHEZZA_TRATTA")
byObject = Autodesk.Civil.DynamoNodes.LandDevelopment.FeatureLine.ByObject(obj=seleziona_featureline)
length3D = Autodesk.Civil.DynamoNodes.LandDevelopment.FeatureLine.Length3D(featureLine=byObject)
number = DoubleInput(3)
round = Math.Round(number=length3D, digits=number)
setPropertyValueByName = Autodesk.AutoCAD.DynamoNodes.PropertySetsExtensions.SetPropertyValueByName(obj=seleziona_featureline, propertySetName=string_7, propertyName=string_9, propertyValue=round)
setPropertyValueByName_2 = Autodesk.AutoCAD.DynamoNodes.PropertySetsExtensions.SetPropertyValueByName(obj=seleziona_featureline, propertySetName=string_8, propertyName=string_9, propertyValue=round)
