# Dynamo graph FeatureLine_to_PipeRuns.dyn (Dynamo 2.12.0.5650)
# packages: Camber 4.2.4, Civil3DToolkit 1.1.32

# group: DOCUMENT PIPE RUNS
current = Autodesk.AutoCAD.DynamoNodes.Document.Current()
getPressureNetworks = Camber.Civil.PressureNetworks.PressureNetwork.GetPressureNetworks(document=current)
pipeRuns = Camber.Civil.PressureNetworks.PressureNetwork.PipeRuns(pressureNetwork=getPressureNetworks)

# group: INPUT
seleziona_featureline = ObjectSelection()  # 1 picked in the model; graph input
name = Autodesk.Civil.DynamoNodes.CivilObject.Name(civilObject=seleziona_featureline)

# group: SEARCH FOR RELATED PR
string_from_object = FromObject(object=pipeRuns)
number = DoubleInput(0)
number_2 = DoubleInput(28)
remove = String.Remove(string=string_from_object, startIndex=number, count=number_2)
number_3 = DoubleInput(-1)
number_4 = DoubleInput(1)
remove_2 = String.Remove(string=remove, startIndex=number_3, count=number_4)
contains = String.Contains(string=remove_2, searchFor=name)

# group: EXTRACT PARTS
filterByBoolMask = List.FilterByBoolMask(list=pipeRuns, mask=contains)
number_5 = DoubleInput(1)
flatten = List.Flatten(list=filterByBoolMask.in, amount=number_5)
parts = Camber.Civil.PressureNetworks.PressurePipeRun.Parts(pressurePipeRun=flatten)
flatten_2 = List.Flatten(list=parts)

# group: SET NAME
name_2 = Autodesk.Civil.DynamoNodes.CivilObject.Name(civilObject=flatten_2)
string = StringInput("(")
startsWith = String.StartsWith(string=name_2, searchFor=string)
string_2 = StringInput("(")
string_3 = StringInput(") ")
concat = String.Concat(string0=string_2, string1=name, string2=string_3)
code_block = CodeBlock(a=concat, b=name_2) { a + b; }
if_ = RefactoredIf(test=startsWith@L1, true=name_2@L1, false=code_block@L1)
setName = Autodesk.Civil.DynamoNodes.CivilObject.SetName(civilObject=flatten_2, name=if_)

# group: SET PROPERTIES
propertySets = Autodesk.AutoCAD.DynamoNodes.Object.PropertySets(object=seleziona_featureline)
properties = Autodesk.AutoCAD.DynamoNodes.PropertySet.Properties(propertySet=propertySets)
name_3 = Autodesk.AutoCAD.DynamoNodes.Property.Name(property=properties)
count = List.Count(list=name_3)
ofRepeatedItem = List.OfRepeatedItem(item=flatten_2, amount=count)
string_from_object_2 = FromObject(object=propertySets)
number_6 = DoubleInput(0)
number_7 = DoubleInput(19)
remove_3 = String.Remove(string=string_from_object_2, startIndex=number_6, count=number_7)
number_8 = DoubleInput(-1)
number_9 = DoubleInput(1)
remove_4 = String.Remove(string=remove_3, startIndex=number_8, count=number_9)
value = Autodesk.AutoCAD.DynamoNodes.Property.Value(property=properties)
setPropertyValueByName = Autodesk.AutoCAD.DynamoNodes.PropertySetsExtensions.SetPropertyValueByName(obj=ofRepeatedItem, propertySetName=remove_4@L1, propertyName=name_3@L2, propertyValue=value@L2)
