# Dynamo graph Pipes_Length.dyn (Dynamo 2.12.0.5650)
# packages: Camber 4.2.4, Civil3DToolkit 1.1.32

# group: PRESSURE PIPES
current = Autodesk.AutoCAD.DynamoNodes.Document.Current()
getPressureNetworks = Camber.Civil.PressureNetworks.PressureNetwork.GetPressureNetworks(document=current)
pressurePipes = Camber.Civil.PressureNetworks.PressureNetwork.PressurePipes(pressureNetwork=getPressureNetworks)
name = Autodesk.Civil.DynamoNodes.PressurePipeNetworks.PressurePipe.Name(pressurePipe=pressurePipes)
getPipeByName = PipeByName(document=current, name=name)

# group: PIPES_LENGTH
string = StringInput("PSET_02_Fisico_geometrico")
string_2 = StringInput("NR_LUNGHEZZA")
length3DCenterToCenter = Autodesk.Civil.DynamoNodes.PressurePipeNetworks.PressurePipe.Length3DCenterToCenter(pressurePipe=getPipeByName)
number = DoubleInput(3)
round = Math.Round(number=length3DCenterToCenter, digits=number)
setPropertyValueByName = Autodesk.AutoCAD.DynamoNodes.PropertySetsExtensions.SetPropertyValueByName(obj=getPipeByName, propertySetName=string, propertyName=string_2, propertyValue=round)
