# Dynamo graph Polyline_to_Elevated_FeatureLine (1).dyn (Dynamo 2.12.0.5650)
# packages: Civil3DToolkit 1.1.32, Clockwork for Dynamo 2.x 2.6.0

# group: Selection
select_polyline = ObjectSelection()  # 1 picked in the model; graph input
select_sections = ObjectsSelection()  # 55 picked in the model; graph input

# group: Insert_Points
string = StringInput("Nome")
geometry = Autodesk.AutoCAD.DynamoNodes.Object.Geometry(object=select_polyline)
current = Autodesk.AutoCAD.DynamoNodes.Document.Current()
getSites = Autodesk.Civil.DynamoNodes.LandDevelopment.Site.GetSites(document=current)
byPolyCurve = Autodesk.Civil.DynamoNodes.LandDevelopment.FeatureLine.ByPolyCurve(name=string, curve=geometry, site=getSites, lacing=CrossProduct)
geometry_2 = Autodesk.AutoCAD.DynamoNodes.Object.Geometry(object=select_sections)
intersect = Geometry.Intersect(geometry=geometry, other=geometry_2)
flatten = List.Flatten(list=intersect)
insertPIPoint = Autodesk.Civil.DynamoNodes.LandDevelopment.FeatureLine.InsertPIPoint(featureLine=byPolyCurve, point=flatten, lacing=Longest)

passthrough = Custom[Passthrough](passThrough=byPolyCurve, waitFor=insertPIPoint)  # package Clockwork for Dynamo 2.x; Forces a sequential order of execution. The node wired into the output of the Passthrough node will be executed *after* the node wired into the waitFor input (e.g. important for some Revit operations). The value of the passThrough input will be passed on to the node wired into the output port of the Passthrough node.

# group: Get_All_Points
getAllPoints = Autodesk.Civil.DynamoNodes.LandDevelopment.FeatureLine.GetAllPoints(featureLine=passthrough)
X = Point.X(point=getAllPoints)
number = DoubleInput(5)
round = Math.Round(number=X, digits=number)
flatten_2 = List.Flatten(list=round)
sort = List.Sort(list=flatten_2)

# group: Isolate_Inserted_Points
X_2 = Point.X(point=flatten)
number_2 = DoubleInput(5)
round_2 = Math.Round(number=X_2, digits=number_2)
sort_2 = List.Sort(list=round_2)

indexOf = List.IndexOf(list=sort, element=sort_2)

# group: Export_Excel
filename = StringInput("Temporary")
sheetname = StringInput("Index")
number_3 = DoubleInput(0)
boolean = BoolSelector(false)
exportToExcel = Data.ExportToExcel(filePath=filename, sheetName=sheetname, startRow=number_3, startColumn=number_3, data=indexOf, writeAsString=boolean)
