# Dynamo graph Polyline_to_Elevated_FeatureLine (2).dyn (Dynamo 2.12.0.5650)
# packages: Civil3DToolkit 1.1.32

# group: Selection
select_featureline = ObjectSelection()  # 1 picked in the model; graph input
byObject = Autodesk.Civil.DynamoNodes.LandDevelopment.FeatureLine.ByObject(obj=select_featureline)

# group: Get_Index_List
select_excel = Filename("C:\Users\C_STC-01\Documents\Temporary.xlsx")
file_from_path = FileObject(path=select_excel)
define_sheetname = StringInput("Index")
importExcel = Data.ImportExcel(file=file_from_path, sheetName=define_sheetname)
transpose = List.Transpose(lists=importExcel)
define_column_0_a = DoubleInput(0)
getItemAtIndex = List.GetItemAtIndex(list=transpose, index=define_column_0_a)

# group: Get_Elevations_List
select_excel_2 = Filename("..\Esempi\FeatureLine.xlsx")  # graph input
file_from_path_2 = FileObject(path=select_excel_2)
define_sheetname_2 = StringInput("C_SX PD")  # graph input
importExcel_2 = Data.ImportExcel(file=file_from_path_2, sheetName=define_sheetname_2)
transpose_2 = List.Transpose(lists=importExcel_2)
define_column_0_a_2 = DoubleInput(1)  # graph input
getItemAtIndex_2 = List.GetItemAtIndex(list=transpose_2, index=define_column_0_a_2)
clean = List.Clean(list=getItemAtIndex_2)
toNumber = String.ToNumber(string=clean)

# group: Set_Elevation_on_Inserted_Points
setPointAbsoluteElevationByIndex = Autodesk.Civil.DynamoNodes.LandDevelopment.FeatureLine.SetPointAbsoluteElevationByIndex(featureLine=byObject, index=getItemAtIndex, elevation=toNumber, lacing=Longest)
