# Dynamo graph Polyline_to_Surface_FeatureLine.dyn "Polyline_to_FeatureLine" (Dynamo 2.12.0.5650)
# packages: Civil3DToolkit 1.1.32, Camber 4.2.4

set_name = StringInput("Feature Line")  # graph input
select_polylines = ObjectsSelection()  # 5 picked in the model; graph input
boolean = BoolSelector(true)
number = DoubleInput(0)
pruneDuplicateVertices = Camber.AutoCAD.Objects.Polyline.PruneDuplicateVertices(polyline=select_polylines, keepFirst=boolean, tolerance=number)
geometry = Autodesk.AutoCAD.DynamoNodes.Object.Geometry(object=pruneDuplicateVertices)
current = Autodesk.AutoCAD.DynamoNodes.Document.Current()
getSites = Autodesk.Civil.DynamoNodes.LandDevelopment.Site.GetSites(document=current)
set_layer = StringInput("C-TOPO-FEAT")  # graph input
byPolyCurve = Autodesk.Civil.DynamoNodes.LandDevelopment.FeatureLine.ByPolyCurve(name=set_name, curve=geometry, site=getSites, layer=set_layer, lacing=CrossProduct)
select_surface = SurfaceNamesDropDown("2687_Superficie Punti")  # graph input
boolean_2 = BoolSelector(false)
setElevationFromSurface = Autodesk.Civil.DynamoNodes.LandDevelopment.FeatureLine.SetElevationFromSurface(featureLine=byPolyCurve, surface=select_surface, includeIntermediate=boolean_2)
