# Dynamo graph Text_to_Excel.dyn "ZData_to_Excel" (Dynamo 2.12.0.5650)
# packages: Civil3DToolkit 1.1.32, Camber 4.2.4

# group: Select_Text
select_textblocks = ObjectsSelection()  # 7 picked in the model; graph input
contents = Camber.AutoCAD.Objects.Text.Contents(text=select_textblocks)
toNumber = String.ToNumber(string=contents)
position = Camber.AutoCAD.Objects.Text.Position(text=select_textblocks)

# group: Sort_by_X
X = Point.X(point=position)

sort = List.Sort(list=X)

# group (continued): Sort_by_X
uniqueItems = List.UniqueItems(list=sort)
allIndicesOf = List.AllIndicesOf(list=X, item=uniqueItems)
getItemAtIndex = List.GetItemAtIndex(list=toNumber, index=allIndicesOf)

# group: Sort_by_Y
Y = Point.Y(point=position)
getItemAtIndex_2 = List.GetItemAtIndex(list=Y, index=allIndicesOf)

# group: Generate_Hierarchy
sortByKey = List.SortByKey(list=getItemAtIndex@L2, keys=getItemAtIndex_2@L2)
reverse = List.Reverse(list=sortByKey.sortedList@L2)

# group: Export_Excel
filename = StringInput("Autostrade")  # graph input
sheetname = StringInput("Sezioni")  # graph input
number = DoubleInput(0)
transpose = List.Transpose(lists=reverse)
boolean = BoolSelector(false)
exportToExcel = Data.ExportToExcel(filePath=filename, sheetName=sheetname, startRow=number, startColumn=number, data=transpose, writeAsString=boolean)
