# Dynamo graph Text_to_FeatureLine.dyn (Dynamo 2.10.1.3976)
# packages: Civil3DToolkit 1.1.32

# group: INPUT
seleziona_tracciato = ObjectSelection()  # 1 picked in the model; graph input
seleziona_testo = ObjectSelection()  # 1 picked in the model; graph input
seleziona_nr_inizio_tratto = ObjectSelection()  # 1 picked in the model; graph input
seleziona_nr_fine_tratto = ObjectSelection()  # 1 picked in the model; graph input
seleziona_wbs = ObjectSelection()  # 1 picked in the model; graph input

# group: TEXT ANALYSIS
contents = Autodesk.AutoCAD.DynamoNodes.MText.Contents()  # frozen; unwired: mText
string = StringInput("OUT = IN[0].InternalDBObject.MText.Text;")
python_script_from_string = PythonStringNode(script=string, IN[0]=seleziona_testo)  # CPython3
string_2 = StringInput("\n")
split = String.Split(str=python_script_from_string, separator0=string_2)

# group: PSET
string_3 = StringInput("PSET_01_Anagrafico_geografico")
string_4 = StringInput("PSET_02_Fisico_geometrico")
string_5 = StringInput("APPOGGIO")
string_6 = StringInput("PSET_03_Esercizio")
string_7 = StringInput("PSET_06_Computazione_Tratti_di_rete")
string_8 = StringInput("PSET_04_Amministrativo")
string_9 = StringInput("PSET_05_Realizzazione")
string_10 = StringInput("PSET_07_Computazione_GR")

# group: COPERTURA
string_11 = StringInput("Copertura")
contains = String.Contains(str=split, searchFor=string_11)
filterByBoolMask = List.FilterByBoolMask(list=split, mask=contains)
string_12 = StringInput(" ")
split_2 = String.Split(str=filterByBoolMask.in, separator0=string_12)
code_block = CodeBlock { ["0","1","2","3","4","5","6","7","8","9"]; }
contains_2 = String.Contains(str=split_2@L1, searchFor=code_block@L2, lacing=CrossProduct)
allFalse = List.AllFalse(list=contains_2@L2)
not_ = Not(x=allFalse@L2)
filterByBoolMask_2 = List.FilterByBoolMask(list=split_2, mask=not_)
toNumber = String.ToNumber(str=filterByBoolMask_2.in)
number = DoubleInput(-1)
mul = toNumber@L1 * number@@L1

# group: FEATURE_LINE
string_13 = StringInput("LIVO")
geometry = Autodesk.AutoCAD.DynamoNodes.Object.Geometry(object=seleziona_tracciato)
current = Autodesk.AutoCAD.DynamoNodes.Document.Current()
byName = Autodesk.Civil.DynamoNodes.LandDevelopment.Site.ByName(document=current, name=string_13)
byPolyCurve = Autodesk.Civil.DynamoNodes.LandDevelopment.FeatureLine.ByPolyCurve(name=string_13, curve=geometry, site=byName)
surfaces = SurfaceNamesDropDown("402_LIVO")  # graph input
boolean = BoolSelector(false)
setElevationFromSurface = Autodesk.Civil.DynamoNodes.LandDevelopment.FeatureLine.SetElevationFromSurface(featureLine=byPolyCurve, surface=surfaces, includeIntermediate=boolean, relElevation=mul)
addPropertySet = Autodesk.AutoCAD.DynamoNodes.Object.AddPropertySet(object=byPolyCurve, propertySetDefinitionName=string_5)
addPropertySet_2 = Autodesk.AutoCAD.DynamoNodes.Object.AddPropertySet(object=byPolyCurve, propertySetDefinitionName=string_4)
addPropertySet_3 = Autodesk.AutoCAD.DynamoNodes.Object.AddPropertySet(object=byPolyCurve, propertySetDefinitionName=string_6)
addPropertySet_4 = Autodesk.AutoCAD.DynamoNodes.Object.AddPropertySet(object=byPolyCurve, propertySetDefinitionName=string_7)
addPropertySet_5 = Autodesk.AutoCAD.DynamoNodes.Object.AddPropertySet(object=byPolyCurve, propertySetDefinitionName=string_3)
addPropertySet_6 = Autodesk.AutoCAD.DynamoNodes.Object.AddPropertySet(object=byPolyCurve, propertySetDefinitionName=string_8)
addPropertySet_7 = Autodesk.AutoCAD.DynamoNodes.Object.AddPropertySet(object=byPolyCurve, propertySetDefinitionName=string_9)
addPropertySet_8 = Autodesk.AutoCAD.DynamoNodes.Object.AddPropertySet(object=byPolyCurve, propertySetDefinitionName=string_10)
delete = Autodesk.AutoCAD.DynamoNodes.Object.Delete(object=seleziona_tracciato)  # frozen
string_14 = StringInput("FeatureLine")
setStyle = Autodesk.AutoCAD.DynamoNodes.DocumentExtensions.SetStyle(obj=byPolyCurve, styleName=string_14)

# group: PSET_01_COMUNITA+COMUNE+FRAZIONE
string_15 = StringInput("NR_COMUNITA_DI_VALLE")
firstItem = List.FirstItem(list=split)
string_16 = StringInput("_")
split_3 = String.Split(str=firstItem, separator0=string_16)
firstItem_2 = List.FirstItem(list=split_3)
boolean_2 = BoolSelector(true)
changeCase = String.ChangeCase(str=firstItem_2, upper=boolean_2)
updateProperty = Autodesk.AutoCAD.DynamoNodes.Object.UpdateProperty(object=byPolyCurve, propertySetName=string_3, propertyName=string_15, propertyValue=changeCase)
string_17 = StringInput("NR_FRAZIONE")
lastItem = List.LastItem(list=split_3)
changeCase_2 = String.ChangeCase(str=lastItem, upper=boolean_2)
updateProperty_2 = Autodesk.AutoCAD.DynamoNodes.Object.UpdateProperty(object=byPolyCurve, propertySetName=string_3, propertyName=string_17, propertyValue=changeCase_2)
string_18 = StringInput("NR_COMUNE")
number_2 = DoubleInput(1)
getItemAtIndex = List.GetItemAtIndex(list=split_3, index=number_2)
changeCase_3 = String.ChangeCase(str=getItemAtIndex, upper=boolean_2)
updateProperty_3 = Autodesk.AutoCAD.DynamoNodes.Object.UpdateProperty(object=byPolyCurve, propertySetName=string_3, propertyName=string_18, propertyValue=changeCase_3)

# group: PSET_02_RIVESTIMENTO
string_19 = StringInput("NR_RIVESTIMENTO")
string_20 = StringInput("Rivestimento tubo")
contains_3 = String.Contains(str=split, searchFor=string_20)
filterByBoolMask_3 = List.FilterByBoolMask(list=split, mask=contains_3)
string_21 = StringInput(" ")
split_4 = String.Split(str=filterByBoolMask_3.in, separator0=string_21)
lastItem_2 = List.LastItem(list=split_4)
updateProperty_4 = Autodesk.AutoCAD.DynamoNodes.Object.UpdateProperty(object=byPolyCurve, propertySetName=string_4, propertyName=string_19, propertyValue=lastItem_2)

# group: PSET_01_PROPRIETARIO+SUBLOTTO
string_22 = StringInput("NR_PROPRIETARIO")
number_3 = DoubleInput(1)
getItemAtIndex_2 = List.GetItemAtIndex(list=split, index=number_3)
string_23 = StringInput("_")
split_5 = String.Split(str=getItemAtIndex_2, separator0=string_23)
firstItem_3 = List.FirstItem(list=split_5)
boolean_3 = BoolSelector(true)
changeCase_4 = String.ChangeCase(str=firstItem_3, upper=boolean_3)
updateProperty_5 = Autodesk.AutoCAD.DynamoNodes.Object.UpdateProperty(object=byPolyCurve, propertySetName=string_3, propertyName=string_22, propertyValue=changeCase_4)
string_24 = StringInput("NR_SUBLOTTO")
string_25 = StringInput("_")
restOfItems = List.RestOfItems(list=split_5)
join = String.Join(separator=string_25, string0=restOfItems)
updateProperty_6 = Autodesk.AutoCAD.DynamoNodes.Object.UpdateProperty(object=byPolyCurve, propertySetName=string_3, propertyName=string_24, propertyValue=join)

# group: PSET_02_MATERIALE+DN
string_26 = StringInput("NR_MATERIALE")
number_4 = DoubleInput(2)
getItemAtIndex_3 = List.GetItemAtIndex(list=split, index=number_4)
string_27 = StringInput(" ")
split_6 = String.Split(str=getItemAtIndex_3, separator0=string_27)
lastItem_3 = List.LastItem(list=split_6)
updateProperty_7 = Autodesk.AutoCAD.DynamoNodes.Object.UpdateProperty(object=byPolyCurve, propertySetName=string_4, propertyName=string_26, propertyValue=lastItem_3)
string_28 = StringInput("MATERIALE")
updateProperty_8 = Autodesk.AutoCAD.DynamoNodes.Object.UpdateProperty(object=byPolyCurve, propertySetName=string_5, propertyName=string_28, propertyValue=lastItem_3)
string_29 = StringInput("NR_DIAMETRO_NOMINALE")
code_block_2 = CodeBlock { ["0","1","2","3","4","5","6","7","8","9"]; }
contains_4 = String.Contains(str=split_6, searchFor=code_block_2@L2, lacing=CrossProduct)
allFalse_2 = List.AllFalse(list=contains_4@L2)
not_2 = Not(x=allFalse_2@L1)
filterByBoolMask_4 = List.FilterByBoolMask(list=split_6, mask=not_2)
toNumber_2 = String.ToNumber(str=filterByBoolMask_4.in)
setPropertyValueByName = Autodesk.AutoCAD.DynamoNodes.PropertySetsExtensions.SetPropertyValueByName(obj=byPolyCurve, propertySetName=string_4, propertyName=string_29, propertyValue=toNumber_2)

# group: PSET_APPOGGIO_SEZIONE
string_30 = StringInput("NR_SEZIONE_TIPO")
string_31 = StringInput("Sezione tipo")
contains_5 = String.Contains(str=split, searchFor=string_31)
filterByBoolMask_5 = List.FilterByBoolMask(list=split, mask=contains_5)
string_32 = StringInput(" ")
split_7 = String.Split(str=filterByBoolMask_5.in, separator0=string_32)
lastItem_4 = List.LastItem(list=split_7)
updateProperty_9 = Autodesk.AutoCAD.DynamoNodes.Object.UpdateProperty(object=byPolyCurve, propertySetName=string_5, propertyName=string_30, propertyValue=lastItem_4)

# group: PSET_03_SPECIE
string_33 = StringInput("NR_SPECIE")
string_34 = StringInput("Specie di tubo")
contains_6 = String.Contains(str=split, searchFor=string_34)
filterByBoolMask_6 = List.FilterByBoolMask(list=split, mask=contains_6)
string_35 = StringInput(" ")
split_8 = String.Split(str=filterByBoolMask_6.in, separator0=string_35)
lastItem_5 = List.LastItem(list=split_8)
updateProperty_10 = Autodesk.AutoCAD.DynamoNodes.Object.UpdateProperty(object=byPolyCurve, propertySetName=string_6, propertyName=string_33, propertyValue=lastItem_5)

# group: PSET_06_PAVIMENTAZIONE
string_36 = StringInput("NR_TIPO_PAVIMENTAZIONE")
string_37 = StringInput("Tipologia di pavimentazione")
contains_7 = String.Contains(str=split, searchFor=string_37)
filterByBoolMask_7 = List.FilterByBoolMask(list=split, mask=contains_7)
string_38 = StringInput(" ")
split_9 = String.Split(str=filterByBoolMask_7.in, separator0=string_38)
lastItem_6 = List.LastItem(list=split_9)
updateProperty_11 = Autodesk.AutoCAD.DynamoNodes.Object.UpdateProperty(object=byPolyCurve, propertySetName=string_7, propertyName=string_36, propertyValue=lastItem_6)

# group: PSET_06_CENTRO
string_39 = StringInput("NR_CENTRO_STORICO")
string_40 = StringInput("CENTRO STORICO")
contains_8 = String.Contains(str=split, searchFor=string_40)
filterByBoolMask_8 = List.FilterByBoolMask(list=split, mask=contains_8)
isEmpty = List.IsEmpty(list=filterByBoolMask_8.in)
not_3 = Not(x=isEmpty)
setPropertyValueByName_2 = Autodesk.AutoCAD.DynamoNodes.PropertySetsExtensions.SetPropertyValueByName(obj=byPolyCurve, propertySetName=string_7, propertyName=string_39, propertyValue=not_3)

# group: PSET_06_STRADA+NR
string_41 = StringInput("NR_TIPO_STRADA-ATTRAV.AEREO-SPINGITUBO")
string_42 = StringInput("Tipo di strada")
contains_9 = String.Contains(str=split, searchFor=string_42)
filterByBoolMask_9 = List.FilterByBoolMask(list=split, mask=contains_9)
string_43 = StringInput(":")
split_10 = String.Split(str=filterByBoolMask_9.in, separator0=string_43)
restOfItems_2 = List.RestOfItems(list=split_10@L2)
string_44 = StringInput(" ")
split_11 = String.Split(str=restOfItems_2, separator0=string_44)
firstItem_4 = List.FirstItem(list=split_11@L2)
updateProperty_12 = Autodesk.AutoCAD.DynamoNodes.Object.UpdateProperty(object=byPolyCurve, propertySetName=string_7, propertyName=string_41, propertyValue=firstItem_4)
string_45 = StringInput("NR_NUMERO_STRADA_SP_SS")
restOfItems_3 = List.RestOfItems(list=split_11@L2)
updateProperty_13 = Autodesk.AutoCAD.DynamoNodes.Object.UpdateProperty(object=byPolyCurve, propertySetName=string_7, propertyName=string_45, propertyValue=restOfItems_3)

# group: PSET_06_AFFIANCATA
string_46 = StringInput("NR_POSA_AFFIANCATA")
string_47 = StringInput("Tipo di posa affiancata")
contains_10 = String.Contains(str=split, searchFor=string_47)
filterByBoolMask_10 = List.FilterByBoolMask(list=split, mask=contains_10)
isEmpty_2 = List.IsEmpty(list=filterByBoolMask_10.in)
string_48 = StringInput("")
string_49 = StringInput("SI")
if_ = If(test=isEmpty_2, true=string_48, false=string_49)
updateProperty_14 = Autodesk.AutoCAD.DynamoNodes.Object.UpdateProperty(object=byPolyCurve, propertySetName=string_7, propertyName=string_46, propertyValue=if_)

# group: PSET_06_NR_TRATTO
string_50 = StringInput("NR_NUMERO_INIZIO_TRATTO")
string_51 = StringInput("XX")
attributeByTag = Autodesk.AutoCAD.DynamoNodes.BlockReference.AttributeByTag(blockReference=seleziona_nr_inizio_tratto, tag=string_51)
toNumber_3 = String.ToNumber(str=attributeByTag)
setPropertyValueByName_3 = Autodesk.AutoCAD.DynamoNodes.PropertySetsExtensions.SetPropertyValueByName(obj=byPolyCurve, propertySetName=string_7, propertyName=string_50, propertyValue=toNumber_3)
string_52 = StringInput("NR_NUMERO_FINE_TRATTO")
attributeByTag_2 = Autodesk.AutoCAD.DynamoNodes.BlockReference.AttributeByTag(blockReference=seleziona_nr_fine_tratto, tag=string_51)
toNumber_4 = String.ToNumber(str=attributeByTag_2)
setPropertyValueByName_4 = Autodesk.AutoCAD.DynamoNodes.PropertySetsExtensions.SetPropertyValueByName(obj=byPolyCurve, propertySetName=string_7, propertyName=string_52, propertyValue=toNumber_4)

# group: WBS
string_53 = StringInput("OUT = IN[0].InternalDBObject.MText.Text;")  # frozen
string_54 = StringInput("NR_WBS")
python_script_from_string_2 = PythonStringNode(script=string, IN[0]=seleziona_wbs)  # CPython3
number_5 = DoubleInput(0)
number_6 = DoubleInput(7)
remove = String.Remove(string=python_script_from_string_2, startIndex=number_5, count=number_6)
setPropertyValueByName_5 = Autodesk.AutoCAD.DynamoNodes.PropertySetsExtensions.SetPropertyValueByName(obj=byPolyCurve, propertySetName=string_8, propertyName=string_54, propertyValue=remove)

# group: PSET_02_LENGTH
string_55 = StringInput("NR_LUNGHEZZA_TRATTA")
length3D = Autodesk.Civil.DynamoNodes.LandDevelopment.FeatureLine.Length3D(featureLine=byPolyCurve)
number_7 = DoubleInput(3)
round = Math.Round(number=length3D, digits=number_7)
setPropertyValueByName_6 = Autodesk.AutoCAD.DynamoNodes.PropertySetsExtensions.SetPropertyValueByName(obj=byPolyCurve, propertySetName=string_5, propertyName=string_55, propertyValue=round)
setPropertyValueByName_7 = Autodesk.AutoCAD.DynamoNodes.PropertySetsExtensions.SetPropertyValueByName(obj=byPolyCurve, propertySetName=string_4, propertyName=string_55, propertyValue=round)
