# Dynamo graph Text_to_Property.dyn "Text_to_Property_V2" (Dynamo 2.10.1.3976)
# packages: Civil3DToolkit 1.1.32

# group: INPUT
seleziona_featureline = ObjectSelection()  # 1 picked in the model; graph input
seleziona_testo = ObjectSelection()  # 1 picked in the model; graph input
seleziona_nr_inizio_tratto = ObjectSelection()  # 1 picked in the model; graph input
seleziona_nr_fine_tratto = ObjectSelection()  # 1 picked in the model; graph input
seleziona_wbs = ObjectSelection()  # 1 picked in the model; graph input

# group: PSET
string = StringInput("PSET_01_Anagrafico_geografico")
string_2 = StringInput("PSET_02_Fisico_geometrico")
string_3 = StringInput("APPOGGIO")
string_4 = StringInput("PSET_03_Esercizio")
string_5 = StringInput("PSET_06_Computazione_Tratti_di_rete")
string_6 = StringInput("PSET_05_Realizzazione")
string_7 = StringInput("PSET_07_Computazione_GR")
string_8 = StringInput("PSET_04_Amministrativo")

# group: TEXT ANALYSIS
string_9 = StringInput("OUT = IN[0].InternalDBObject.MText.Text;")
python_script_from_string = PythonStringNode(script=string_9, IN[0]=seleziona_testo)  # CPython3
string_10 = StringInput("\n")
split = String.Split(str=python_script_from_string, separator0=string_10)

# group: PSET_01_COMUNITA+COMUNE+FRAZIONE
string_11 = StringInput("NR_COMUNITA_DI_VALLE")
firstItem = List.FirstItem(list=split)
string_12 = StringInput("_")
split_2 = String.Split(str=firstItem, separator0=string_12)
firstItem_2 = List.FirstItem(list=split_2)
boolean = BoolSelector(true)
changeCase = String.ChangeCase(str=firstItem_2, upper=boolean)
updateProperty = Autodesk.AutoCAD.DynamoNodes.Object.UpdateProperty(object=seleziona_featureline, propertySetName=string, propertyName=string_11, propertyValue=changeCase)
string_13 = StringInput("NR_FRAZIONE")
lastItem = List.LastItem(list=split_2)
changeCase_2 = String.ChangeCase(str=lastItem, upper=boolean)
updateProperty_2 = Autodesk.AutoCAD.DynamoNodes.Object.UpdateProperty(object=seleziona_featureline, propertySetName=string, propertyName=string_13, propertyValue=changeCase_2)
string_14 = StringInput("NR_COMUNE")
number = DoubleInput(1)
getItemAtIndex = List.GetItemAtIndex(list=split_2, index=number)
changeCase_3 = String.ChangeCase(str=getItemAtIndex, upper=boolean)
updateProperty_3 = Autodesk.AutoCAD.DynamoNodes.Object.UpdateProperty(object=seleziona_featureline, propertySetName=string, propertyName=string_14, propertyValue=changeCase_3)

# group: PSET_02_RIVESTIMENTO
string_15 = StringInput("NR_RIVESTIMENTO")
string_16 = StringInput("Rivestimento tubo")
contains = String.Contains(str=split, searchFor=string_16)
filterByBoolMask = List.FilterByBoolMask(list=split, mask=contains)
string_17 = StringInput(" ")
split_3 = String.Split(str=filterByBoolMask.in, separator0=string_17)
lastItem_2 = List.LastItem(list=split_3)
updateProperty_4 = Autodesk.AutoCAD.DynamoNodes.Object.UpdateProperty(object=seleziona_featureline, propertySetName=string_2, propertyName=string_15, propertyValue=lastItem_2)

# group: PSET_01_PROPRIETARIO+SUBLOTTO
string_18 = StringInput("NR_PROPRIETARIO")
number_2 = DoubleInput(1)
getItemAtIndex_2 = List.GetItemAtIndex(list=split, index=number_2)
string_19 = StringInput("_")
split_4 = String.Split(str=getItemAtIndex_2, separator0=string_19)
firstItem_3 = List.FirstItem(list=split_4)
boolean_2 = BoolSelector(true)
changeCase_4 = String.ChangeCase(str=firstItem_3, upper=boolean_2)
updateProperty_5 = Autodesk.AutoCAD.DynamoNodes.Object.UpdateProperty(object=seleziona_featureline, propertySetName=string, propertyName=string_18, propertyValue=changeCase_4)
string_20 = StringInput("NR_SUBLOTTO")
string_21 = StringInput("_")
restOfItems = List.RestOfItems(list=split_4)
join = String.Join(separator=string_21, string0=restOfItems)
updateProperty_6 = Autodesk.AutoCAD.DynamoNodes.Object.UpdateProperty(object=seleziona_featureline, propertySetName=string, propertyName=string_20, propertyValue=join)

# group: PSET_02_MATERIALE+DN
string_22 = StringInput("NR_MATERIALE")
number_3 = DoubleInput(2)
getItemAtIndex_3 = List.GetItemAtIndex(list=split, index=number_3)
string_23 = StringInput(" ")
split_5 = String.Split(str=getItemAtIndex_3, separator0=string_23)
lastItem_3 = List.LastItem(list=split_5)
updateProperty_7 = Autodesk.AutoCAD.DynamoNodes.Object.UpdateProperty(object=seleziona_featureline, propertySetName=string_2, propertyName=string_22, propertyValue=lastItem_3)
string_24 = StringInput("MATERIALE")
updateProperty_8 = Autodesk.AutoCAD.DynamoNodes.Object.UpdateProperty(object=seleziona_featureline, propertySetName=string_3, propertyName=string_24, propertyValue=lastItem_3)
string_25 = StringInput("NR_DIAMETRO_NOMINALE")
code_block = CodeBlock { ["0","1","2","3","4","5","6","7","8","9"]; }
contains_2 = String.Contains(str=split_5, searchFor=code_block@L2, lacing=CrossProduct)
allFalse = List.AllFalse(list=contains_2@L2)
not_ = Not(x=allFalse@L1)
filterByBoolMask_2 = List.FilterByBoolMask(list=split_5, mask=not_)
toNumber = String.ToNumber(str=filterByBoolMask_2.in)
setPropertyValueByName = Autodesk.AutoCAD.DynamoNodes.PropertySetsExtensions.SetPropertyValueByName(obj=seleziona_featureline, propertySetName=string_2, propertyName=string_25, propertyValue=toNumber)

# group: PSET_APPOGGIO_SEZIONE
string_26 = StringInput("NR_SEZIONE_TIPO")
string_27 = StringInput("Sezione tipo")
contains_3 = String.Contains(str=split, searchFor=string_27)
filterByBoolMask_3 = List.FilterByBoolMask(list=split, mask=contains_3)
string_28 = StringInput(" ")
split_6 = String.Split(str=filterByBoolMask_3.in, separator0=string_28)
lastItem_4 = List.LastItem(list=split_6)
updateProperty_9 = Autodesk.AutoCAD.DynamoNodes.Object.UpdateProperty(object=seleziona_featureline, propertySetName=string_3, propertyName=string_26, propertyValue=lastItem_4)

# group: PSET_03_SPECIE
string_29 = StringInput("NR_SPECIE")
string_30 = StringInput("Specie di tubo")
contains_4 = String.Contains(str=split, searchFor=string_30)
filterByBoolMask_4 = List.FilterByBoolMask(list=split, mask=contains_4)
string_31 = StringInput(" ")
split_7 = String.Split(str=filterByBoolMask_4.in, separator0=string_31)
lastItem_5 = List.LastItem(list=split_7)
updateProperty_10 = Autodesk.AutoCAD.DynamoNodes.Object.UpdateProperty(object=seleziona_featureline, propertySetName=string_4, propertyName=string_29, propertyValue=lastItem_5)

# group: PSET_06_PAVIMENTAZIONE
string_32 = StringInput("NR_TIPO_PAVIMENTAZIONE")
string_33 = StringInput("Tipologia di pavimentazione")
contains_5 = String.Contains(str=split, searchFor=string_33)
filterByBoolMask_5 = List.FilterByBoolMask(list=split, mask=contains_5)
string_34 = StringInput(" ")
split_8 = String.Split(str=filterByBoolMask_5.in, separator0=string_34)
lastItem_6 = List.LastItem(list=split_8)
updateProperty_11 = Autodesk.AutoCAD.DynamoNodes.Object.UpdateProperty(object=seleziona_featureline, propertySetName=string_5, propertyName=string_32, propertyValue=lastItem_6)

# group: PSET_06_CENTRO
string_35 = StringInput("NR_CENTRO_STORICO")
string_36 = StringInput("CENTRO STORICO")
contains_6 = String.Contains(str=split, searchFor=string_36)
filterByBoolMask_6 = List.FilterByBoolMask(list=split, mask=contains_6)
isEmpty = List.IsEmpty(list=filterByBoolMask_6.in)
not_2 = Not(x=isEmpty)
setPropertyValueByName_2 = Autodesk.AutoCAD.DynamoNodes.PropertySetsExtensions.SetPropertyValueByName(obj=seleziona_featureline, propertySetName=string_5, propertyName=string_35, propertyValue=not_2)

# group: PSET_06_STRADA+NR
string_37 = StringInput("NR_TIPO_STRADA-ATTRAV.AEREO-SPINGITUBO")
string_38 = StringInput("Tipo di strada")
contains_7 = String.Contains(str=split, searchFor=string_38)
filterByBoolMask_7 = List.FilterByBoolMask(list=split, mask=contains_7)
string_39 = StringInput(":")
split_9 = String.Split(str=filterByBoolMask_7.in, separator0=string_39)
restOfItems_2 = List.RestOfItems(list=split_9@L2)
string_40 = StringInput(" ")
split_10 = String.Split(str=restOfItems_2, separator0=string_40)
firstItem_4 = List.FirstItem(list=split_10@L2)
updateProperty_12 = Autodesk.AutoCAD.DynamoNodes.Object.UpdateProperty(object=seleziona_featureline, propertySetName=string_5, propertyName=string_37, propertyValue=firstItem_4)
string_41 = StringInput("NR_NUMERO_STRADA_SP_SS")
restOfItems_3 = List.RestOfItems(list=split_10@L2)
updateProperty_13 = Autodesk.AutoCAD.DynamoNodes.Object.UpdateProperty(object=seleziona_featureline, propertySetName=string_5, propertyName=string_41, propertyValue=restOfItems_3)

# group: PSET_06_AFFIANCATA
string_42 = StringInput("NR_POSA_AFFIANCATA")
string_43 = StringInput("Tipo di posa affiancata")
contains_8 = String.Contains(str=split, searchFor=string_43)
filterByBoolMask_8 = List.FilterByBoolMask(list=split, mask=contains_8)
isEmpty_2 = List.IsEmpty(list=filterByBoolMask_8.in)
string_44 = StringInput("")
string_45 = StringInput("SI")
if_ = If(test=isEmpty_2, true=string_44, false=string_45)
updateProperty_14 = Autodesk.AutoCAD.DynamoNodes.Object.UpdateProperty(object=seleziona_featureline, propertySetName=string_5, propertyName=string_42, propertyValue=if_)

# group: PSET_06_NR_TRATTO
string_46 = StringInput("NR_NUMERO_INIZIO_TRATTO")
string_47 = StringInput("XX")
attributeByTag = Autodesk.AutoCAD.DynamoNodes.BlockReference.AttributeByTag(blockReference=seleziona_nr_inizio_tratto, tag=string_47)
toNumber_2 = String.ToNumber(str=attributeByTag)
setPropertyValueByName_3 = Autodesk.AutoCAD.DynamoNodes.PropertySetsExtensions.SetPropertyValueByName(obj=seleziona_featureline, propertySetName=string_5, propertyName=string_46, propertyValue=toNumber_2)
string_48 = StringInput("NR_NUMERO_FINE_TRATTO")
attributeByTag_2 = Autodesk.AutoCAD.DynamoNodes.BlockReference.AttributeByTag(blockReference=seleziona_nr_fine_tratto, tag=string_47)
toNumber_3 = String.ToNumber(str=attributeByTag_2)
setPropertyValueByName_4 = Autodesk.AutoCAD.DynamoNodes.PropertySetsExtensions.SetPropertyValueByName(obj=seleziona_featureline, propertySetName=string_5, propertyName=string_48, propertyValue=toNumber_3)

# group: WBS
string_49 = StringInput("NR_WBS")
python_script_from_string_2 = PythonStringNode(script=string_9, IN[0]=seleziona_wbs)  # CPython3
number_4 = DoubleInput(0)
number_5 = DoubleInput(7)
remove = String.Remove(string=python_script_from_string_2, startIndex=number_4, count=number_5)
setPropertyValueByName_5 = Autodesk.AutoCAD.DynamoNodes.PropertySetsExtensions.SetPropertyValueByName(obj=seleziona_featureline, propertySetName=string_8, propertyName=string_49, propertyValue=remove)

# group: PSET_02_LENGTH
string_50 = StringInput("NR_LUNGHEZZA_TRATTA")
byObject = Autodesk.Civil.DynamoNodes.LandDevelopment.FeatureLine.ByObject(obj=seleziona_featureline)
length3D = Autodesk.Civil.DynamoNodes.LandDevelopment.FeatureLine.Length3D(featureLine=byObject)
number_6 = DoubleInput(3)
round = Math.Round(number=length3D, digits=number_6)
setPropertyValueByName_6 = Autodesk.AutoCAD.DynamoNodes.PropertySetsExtensions.SetPropertyValueByName(obj=seleziona_featureline, propertySetName=string_3, propertyName=string_50, propertyValue=round)
setPropertyValueByName_7 = Autodesk.AutoCAD.DynamoNodes.PropertySetsExtensions.SetPropertyValueByName(obj=seleziona_featureline, propertySetName=string_2, propertyName=string_50, propertyValue=round)
